# Grasshopper definition Speckle Trib Area_v3 (1).gh (Grasshopper 1.0.7)
# plug-ins: Speckle 2, Kangaroo2 Components, Karamba3D

# https://app.speckle.systems/projects/0a088653cb/models/05fb82a423
panel = Panel("https://app.speckle.systems/projects/0a088653cb/models/7da6d64609")
receive = Receive(
    Stream=panel,
    AutoReceive=True,
    CurrentComponentState="up_to_date",
    ExpandOutput=True,
    LastInfoMessage="Laszlo Andrasi @ 10/27/2024 01:38:12: Sent 46 objects from Revit2023. (id:986f829765)",
    ReceiveOnOpen=False,
    ReceivedCommitId="986f829765",
    StreamWrapper="https://app.speckle.systems/projects/0a088653cb/models/revit/exchange/floors&columns",
    selectedKitName="Objects")  # -> Info, CollectionType, Elements, Info_2, Name, Types
panel_2 = Panel(receive.Elements)

cluster = Cluster_2(T=receive.Elements)  # -> outline, parameters, baseline, elementid, baseline_2, elementid_2, extruded_walls
cluster_2 = Cluster(O=cluster.parameters)  # -> simplify(value)
crv = Curve(cluster.outline)
crv_2 = Curve(cluster.baseline)
boundary = BoundarySurfaces(Edges=flatten(crv))
end = EndPoints(Curve=crv_2)  # -> Start, End
pull = PullPoint(Point=end.End, Geometry=boundary, ClosestOnly=True)  # -> ClosestPoint, Distance
ln = Line(StartPoint=end.Start, EndPoint=pull.ClosestPoint)
crv_3 = Curve(flatten(ln))
brep = Brep(flatten(boundary))
dupln = RemoveDuplicateLines(Lines=crv_3, Tolerance=0.01)

srf = Surface(cluster.extruded_walls)
panel_3 = Panel(cluster_2)
panel_4 = Panel("""OFFICE
RESI""")
panel_5 = Panel("""50
100""")
keysearch = KeyValueSearch(Keys=panel_4, Values=panel_5, Search=cluster_2)

num = Number(flatten(keysearch))
geo = Geometry(flatten(brep))
geo_2 = Geometry(flatten(dupln))
geo_3 = Geometry(flatten([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]))  # disabled

area = Area(Geometry=geo)  # -> Area, Centroid
pdecon = Deconstruct(Point=area.Centroid)  # -> XComponent, YComponent, ZComponent
sort = SortList(Keys=pdecon.ZComponent, ValuesA=geo, ValuesB=num)  # -> Keys, ValuesA, ValuesB
join = JoinCurves(Curves=geo_2, Preserve=False)
brep_2 = Brep(sort.ValuesA)
bcx = BrepCurve(Brep=brep_2, Curve=graft(join))  # -> Curves, Points
bcx_2 = BrepCurve(Brep=graft(brep_2), Curve=join)  # -> Curves, Points
pshift = ShiftPaths(Data=simplify(bcx.Points), Offset=-1)
pshift_2 = ShiftPaths(Data=simplify(bcx_2.Points), Offset=-1)
crv_cp = CurveClosestPoint(Point=pshift, Curve=reparameterize(graft(join)))  # -> Point, Parameter, Distance
pt = Point(pshift_2)
voronoi = Voronoi(Points=pt, Plane=graft(brep_2), BruteForceOverride=False)
shatter = Shatter(Curve=reparameterize(graft(join)), Parameters=crv_cp.Parameter)
pt_2 = Point(crv_cp.Point)
rint = RegionIntersection(CurvesA=voronoi, CurvesB=graft(brep_2), Plane=graft(brep_2))
end_2 = EndPoints(Curve=shatter)  # -> Start, End
crv_4 = Curve(shatter)
area_2 = Area(Geometry=rint)  # -> Area, Centroid
pt_3 = Point(end_2.End)
multiplication = Multiplication(A=graft(sort.ValuesB), B=area_2.Area)
keysearch_2 = KeyValueSearch(Keys=flatten(pt), Values=flatten(multiplication), Search=pt_3)  # -> reverse(Result)

# ---- group: Get Column Bot Points
pt_4 = Point(end_2.Start)
pdecon_2 = Deconstruct(Point=pt_4)  # -> XComponent, YComponent, ZComponent
sort_2 = SortList(Keys=flatten(pdecon_2.ZComponent), ValuesA=flatten(pt_4))  # -> Keys, ValuesA
item = ListItem(List=sort_2.Keys, Index=0, Wrap=True)
equals = Equality(FirstNumber=sort_2.Keys, SecondNumber=item)  # -> Equality, Inequality
cull = CullPattern(List=flatten(sort_2.ValuesA), CullPattern=equals.Equality)
pt_5 = Point(cull)

# ----
ma = MassAddition(Input=keysearch_2)  # -> Result, reverse(PartialResults)
num_2 = Number(ma.PartialResults)
_10º = PowerOf10(Value=Slider(4.3, range=0..10))
bnd = Bounds(Numbers=flatten(num_2))
one_over_x = OneOverX(Value=_10º)
multiplication_2 = Multiplication(A=one_over_x, B=num_2)
dedomain = DeconstructDomain(Domain=bnd)  # -> Start, End
gradient = Gradient(
    LowerLimit=flatten(dedomain.Start),
    UpperLimit=flatten(dedomain.End),
    Parameter=num_2,
    stops=[0: RGB(48, 18, 59), 0.0312: RGB(57, 41, 114), 0.0625: RGB(64, 64, 161), 0.0938: RGB(68, 86, 199), 0.125: RGB(70, 107, 227), 0.156: RGB(70, 127, 246)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])
pipe = Pipe(Curve=shatter, Radius=multiplication_2, Caps=0)
pshift_3 = ShiftPaths(Data=simplify(pipe), Offset=-1)
panel_6 = Panel(num_2)
mesh_uv = MeshSurface(Surface=pshift_3, UCount=Slider(10, range=0..10), VCount=Slider(20, range=0..100), Overhang=True, Equalize=False)

number_slider = Slider(6, range=0..10)
division = Division(A=num_2, B=Slider(100, range=0..100))
midpt = CurveMiddle(Curve=crv_4)
sqrt = SquareRoot(Value=division)
division_2 = Division(A=sqrt, B=number_slider)
round = Round(Number=division_2)  # -> Nearest, Floor, Ceiling
multiplication_3 = Multiplication(A=round.Ceiling, B=number_slider)
division_3 = Division(A=multiplication_3, B=12)
division_4 = Division(A=division_3, B=2)
tag = TextTag(Location=midpt, Text=multiplication_3)
pipe_2 = Pipe(Curve=crv_4, Radius=division_4, Caps=0)

X = UnitX(Factor=multiplication_2)
extr = Extrude(Base=crv_4, Direction=X)
mesh_uv_2 = MeshSurface(Surface=extr, UCount=Slider(5, range=0..10), VCount=Slider(10, range=0..100), Overhang=True, Equalize=False)
mcol = MeshColours(Mesh=graft(mesh_uv_2), Colours=graft(gradient))

preview = CustomPreview(Geometry=pshift_3, Material=gradient)
mcol_2 = MeshColours(Mesh=graft(mesh_uv), Colours=graft(gradient))
mesh = Mesh(mcol)
license = LicenseKaramba3D()
settings = SettingsKaramba3D(menu=[dropdown(4)])  # -> AllSettings, GenericOutput

column_id = Data(flatten(cluster.elementid))
new_column_sizes = Data(simplify(flatten(multiplication_3)))
crv_5 = Curve(flatten(crv_2))
concat = Concatenate(FragmentA=new_column_sizes, FragmentB="\"")
panel_7 = Panel(column_id)
panel_8 = Panel(crv_5)
panel_9 = Panel(concat)

number_slider_2 = Slider(0, range=0..10)

series = Series(Start=Slider(12, range=0..100), Step=Slider(4, range=0..10), Count=Slider(20, range=0..100))
matselect = MaterialSelectionKaramba3D(menu=[dropdown(7), dropdown(6)])
division_5 = Division(A=series, B=2)
cross_section = CrossSectionKaramba3D(
    FamilyNameOfCrossSection="DefaultCroSec",
    NameOfCrossSection=series,
    Material=matselect,
    Diameter_cm=series,
    WallThickness_cm=division_5,
    mode="Circular Hollow")
crv_6 = Curve(flatten(crv_4))
pt_6 = Point(flatten(pt_2))
brep_3 = Brep(brep_2)
mesh_breps = MeshBrepsKaramba3D(
    Brep=brep_3,
    InclusionPoints=pt_6,
    MeshResolution=Slider(4, range=0..10),
    EdgeRefinementFactor=0.67,
    PointReduction=False,
    SmoothingStepSize=0,
    SmoothingIterations=5)  # -> Mesh, Info
Z = UnitZ(Factor="1")
pt_7 = Point(cull)
supp = SupportKaramba3D(PosInd=pt_7, menu=[buttons(on, on, on, off, off, off)])
meshtoshell = MeshToShellKaramba3D(Mesh=mesh_breps.Mesh, LimitDistance_m=0.005)  # -> Element, Points, Info
loads = LoadsKaramba3D(Vector=Z, Mesh=mesh_breps.Mesh, LCase="All", mode="MeshLoad -Const.", menu=[buttons(on, off, off), buttons(on, on)])

item_2 = ListItem(List=cross_section, Index=0, Wrap=True)

panel_10 = Panel("https://app.speckle.systems/projects/0a088653cb/models/d31d126efb")
receive_2 = Receive(
    Stream=panel_10,
    AutoReceive=True,
    CurrentComponentState="up_to_date",
    ExpandOutput=True,
    LastInfoMessage="Laszlo Andrasi @ 10/27/2024 00:12:34: Sent 88 objects from Revit2023. (id:d34f1c7ed7)",
    ReceiveOnOpen=False,
    ReceivedCommitId="d34f1c7ed7",
    StreamWrapper="https://app.speckle.systems/projects/0a088653cb/models/d31d126efb",
    selectedKitName="Objects")  # -> Info, CollectionType, Elements, Info_2, Levels, Name, Types
cluster_3 = Cluster_3(O=receive_2.Types)  # -> family, type
panel_11 = Panel(cluster_3.family)
item_3 = ListItem(List=flatten(cluster_3.family), Index=number_slider_2, Wrap=True)

data = Data(flatten(cluster_3.type))

panel_12 = Panel(data)

item_4 = ListItem(List=flatten(receive_2.Levels), Index=Slider(1, range=0..10), Wrap=True)
item_5 = ListItem(List=flatten(receive_2.Levels), Index=number_slider_2, Wrap=True)
mindex = MemberIndex(Set=data, Member=concat)  # -> flatten(Index), Count
item_6 = ListItem(List=flatten(cluster_3.type), Index=mindex.Index, Wrap=True)
panel_13 = Panel(item_6)

sso = RevitColumnVertical(
    Family=item_3,
    Type=item_6,
    BaseLine=crv_5,
    Level=item_5,
    TopLevel=item_4,
    BaseOffset=0,
    TopOffset=0,
    Structural=Toggle(True),
    Rotation=0,
    SelectedConstructorName="Objects.BuiltElements.Revit.RevitColumn.ctor(System.String,System.String,Objects.ICurve,Objects.BuiltElements.Level,Objects.BuiltElements.Level,System.Double,System.Double,System.Boolean,System.Double,System.Collections.Generic.List`1[Objects.BuiltElements.Revit.Parameter])",
    SelectedTypeName="Objects.BuiltElements.Revit.RevitColumn",
    UseSchemaTag=False,
    UserSetSchemaTag=False,
    seed="8f8297bfe18b8727b88d")
panel_14 = Panel("https://app.speckle.systems/projects/0a088653cb/models/a2dfba037b")
send = Send(
    Stream=panel_14,
    Data=sso,
    AutoSend=True,
    BaseId="9e90f0b7f0da1816354ed1548d8ec574",
    CurrentComponentState="up_to_date",
    KitName="Objects",
    OutputWrappers="https://app.speckle.systems\t0a088653cb\t55909ec906",
    UseDefaultCache=True,
    selectedKitName="Objects")

linetobeam = LineToBeamKaramba3D(
    Line=crv_6,
    CrossSection=item_2,
    New=True,
    Remove=True,
    LimitDistance_m=0.005,
    Bending=True,
    SetBucklingLength=True,
    ToPolylineMaxAngle=0.03,
    ToPolylineTolerance=0.01,
    ToPolylineMaxEdgeLength=0.25)  # -> Element, Points, Info
assemble = AssembleModelKaramba3D(Elem=flatten([linetobeam.Element, meshtoshell.Element]), Support=supp, Load=loads, LimitDistance_mm=0.005)  # -> Model, Info, Mass_kg, CenterOfGravity, LoadCaseNames

analyze = AnalyzeKaramba3D(Model=assemble.Model)  # -> CalculatedModel, MaximumDisplacement_cm, ResultingForceOfGravity_kN, ElasticEnergyChange_kNm
opticrosec = OptimizeCrossSectionKaramba3D(
    Model=assemble.Model,
    CrossSections=cross_section,
    MaximumUtilization=Slider(0.1, range=0..0.1),
    UltimateLimitStateIterations=5,
    DisplacementIterations=5,
    NumberOfSamplePoints=3,
    ElasticDesign=True,
    GammaM0=1,
    GammaM1=1.1,
    SwayFrame=True)  # -> ModelWithOptimizedCrossSections, Info, Mass_kg, MaximumDisplacement_cm, ElasticEnergyChange_kNm

modelview = ModelViewKaramba3D(Model=opticrosec.ModelWithOptimizedCrossSections, ResultFactors=1, ResultCase=-1)  # -> Model, DeformedMesh, DeformedAxes, DeformedModel
shellview = ShellViewKaramba3D(Model=modelview.Model, IndexOfLayer=0)  # -> Model, MeshesOfRenderedShells, LegendColors, LegendTags
beamview = BeamViewKaramba3D(Model=modelview.Model)  # -> Model, MeshesOfRenderedBeams, DeformedBeamAxes, LegendColors, LegendTags
beamview_2 = BeamViewKaramba3D(Model=modelview.Model)  # -> Model, MeshesOfRenderedBeams, DeformedBeamAxes, LegendColors, LegendTags

beamview_3 = BeamViewKaramba3D(Model=modelview.Model)  # -> Model, MeshesOfRenderedBeams, DeformedBeamAxes, LegendColors, LegendTags

karamba_axial_forces = Mesh(beamview_2.MeshesOfRenderedBeams)
axial_forces = Mesh(flatten(mesh))
panel_15 = Panel("https://app.speckle.systems/projects/0a088653cb/models/bbde214205")
panel_16 = Panel("https://app.speckle.systems/projects/0a088653cb/models/5feb88aba3")
panel_17 = Panel("https://app.speckle.systems/projects/0a088653cb/models/7ffc65a67a")
send_2 = Send(
    Stream=panel_15,
    Data=beamview.MeshesOfRenderedBeams,
    AutoSend=True,
    BaseId="d0a8f5599ba5a6649b45d3ef1825af30",
    CurrentComponentState="up_to_date",
    KitName="Objects",
    OutputWrappers="https://app.speckle.systems\t0a088653cb\t48ec68b99a",
    UseDefaultCache=True,
    selectedKitName="Objects")
send_3 = Send(
    Stream=panel_16,
    Data=karamba_axial_forces,
    AutoSend=True,
    BaseId="8f296e71352cec2cc20454f97a123f7f",
    CurrentComponentState="up_to_date",
    KitName="Objects",
    OutputWrappers="https://app.speckle.systems\t0a088653cb\t71b538646c",
    UseDefaultCache=True,
    selectedKitName="Objects")
send_4 = Send(
    Stream=panel_17,
    Data=shellview.MeshesOfRenderedShells,
    AutoSend=True,
    BaseId="e644c28dd8889e123d5cd864f36c427a",
    CurrentComponentState="up_to_date",
    KitName="Objects",
    OutputWrappers="https://app.speckle.systems\t0a088653cb\t67e7f4b507",
    UseDefaultCache=True,
    selectedKitName="Objects")

# ==== cluster Cluster
O = ClusterInput()
dso = DeconstructSpeckleObject(SpeckleObject=O, selectedKitName="Objects")  # -> ALL_MODEL_COST, ALL_MODEL_DESCRIPTION, ALL_MODEL_IMAGE, ALL_MODEL_INSTANCE_COMMENTS, ALL_MODEL_MANUFACTURER, ALL_MODEL_MODEL, ALL_MODEL_TYPE_COMMENTS, ALL_MODEL_TYPE_IMAGE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
dso_2 = DeconstructSpeckleObject(SpeckleObject=dso.ALL_MODEL_INSTANCE_COMMENTS, selectedKitName="Objects")  # -> ApplicationInternalName, ApplicationUnit, ApplicationUnitType, IsReadOnly, IsShared, IsTypeParameter, Name, Units, Value
value = ClusterOutput(dso_2.Value)

# ==== cluster Cluster_2
T = ClusterInput()
panel = Panel("""Columns
Walls
Floors""")
tmatch = MatchText(Text=T, RegEx=graft(panel), Case=True)
cull = CullPattern(List=T, CullPattern=tmatch)
bang = ExplodeTree(Data=cull)  # -> Branch0, Branch1, Branch2
dso = DeconstructSpeckleObject(SpeckleObject=bang.Branch2, selectedKitName="Objects")  # -> CollectionType, Elements, Name
dso_2 = DeconstructSpeckleObject(SpeckleObject=bang.Branch0, selectedKitName="Objects")  # -> CollectionType, Elements, Name
dso_3 = DeconstructSpeckleObject(SpeckleObject=bang.Branch1, selectedKitName="Objects")
dso_4 = DeconstructSpeckleObject(SpeckleObject=simplify(dso_3), selectedKitName="Objects")  # -> simplify(BaseLine), ElementId, Elements, Height, Voids
dso_5 = DeconstructSpeckleObject(SpeckleObject=dso.Elements, selectedKitName="Objects")  # -> BuiltInCategory, Category, DisplayValue, ElementId, Elements, Family, IsRevitLinkedModel, Level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
dso_6 = DeconstructSpeckleObject(SpeckleObject=dso_2.Elements, selectedKitName="Objects")  # -> BaseLine, BaseOffset, BuiltInCategory, Category, DisplayValue, ElementId, FacingFlipped, Family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
outline = ClusterOutput(dso_5.Outline)
parameters = ClusterOutput(dso_5.Parameters)
baseline = ClusterOutput(dso_6.BaseLine)
elementid = ClusterOutput(dso_6.ElementId)
baseline_2 = ClusterOutput(dso_4.BaseLine)
elementid_2 = ClusterOutput(dso_4.ElementId)
boundary = BoundarySurfaces(Edges=flatten(dso_5.Outline))
data = Data(dso_4.Elements)
crv = Curve(dso_4.Voids)
lng = ListLength(List=crv)
larger = LargerThan(FirstNumber=lng, SecondNumber=0)  # -> LargerThan, OrEqualTo
cull_2 = CullPattern(List=dso_4.BaseLine, CullPattern=larger.LargerThan)
cull_3 = CullPattern(List=dso_4.Height, CullPattern=larger.LargerThan)
multiplication = Multiplication(A=cull_3, B=3.28084)
crv_2 = Curve(cull_2)
division = Division(A=multiplication, B=1000)
Z = UnitZ(Factor=division)
extr = Extrude(Base=crv_2, Direction=Z)
extruded_walls = ClusterOutput(extr)
axial_forces = Mesh()

# ==== cluster Cluster_3
O = ClusterInput()
dso = DeconstructSpeckleObject(SpeckleObject=O, selectedKitName="Objects")  # -> AnalyticalPipeConnections, CableTray, Ceilings, Conduit, CurtaSystem, CurtainWallMullions, CurtainWallPanels, DetailComponents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
dso_2 = DeconstructSpeckleObject(SpeckleObject=dso.StructuralColumns, selectedKitName="Objects")  # -> BuiltInCategory, Category, DisplayValue, ElementId, Elements, Family, IsRevitLinkedModel, MaterialQuantities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
family = ClusterOutput(dso_2.Family)
type = ClusterOutput(dso_2.Type)
